# Grasshopper definition animation_piton.ghx (Grasshopper 1.0.7)
# plug-ins: Human

reset = BooleanToggle(True)
c_script = CSharpScript(reset=reset)  # -> out, B, C, state; inputs reset: Boolean
# ---------- c_script: C# usings ----------
using System.IO;
using System.Linq;
using System.Data;
using System.Drawing;
using System.Reflection;
using System.Windows.Forms;
using System.Xml;
using System.Xml.Linq;
using System.Runtime.InteropServices;

using Rhino.DocObjects;
using Rhino.Collections;
using GH_IO;
using GH_IO.Serialization;
# ---------- c_script: C# ----------
    if(!reset){
      c++;
    }else{
      c = -1;
    }
    c = (int) (c % (201));
    if(c <= 200){
      B = true;
    }else{
      B = false;
    }


    C = c;
    if(!reset)
    {
      state = 1;
    }
    else
    {
      state = 0;
    }
# ---------- c_script: C# additional code ----------
  int c = -1;
# ---------- end c_script ----------
timer = Timer(TimerInterval=20, Target=c_script)
initial_location = Point([Point(14.40319408, 13.49983265, 0), Point(14.4020021, 12.70881193, 0)])
initial_state = Integer([0, 0])
checkselectedobject = GhPythonScript(counter=c_script.C, reset=reset)  # -> anySelected
# ---------- checkselectedobject: Python ----------
from ghpythonlib.componentbase import executingcomponent as component
import Grasshopper, GhPython
import System
import Rhino
import rhinoscriptsyntax as rs

from Rhino.DocObjects import BrepObject


import scriptcontext as sc
import Rhino as rh
        
import System
import Rhino.UI
import Eto.Drawing as drawing
import Eto.Forms as forms

import csv
        
maxAttributes = 0
#forms.DynamicLayout.AddSpace(
templates = []

class ObjectTemplate():
    def __init__(self,name):
        self.name = name
        self.attributes = []
        self.activities = []
        
    def AddAttribute(self,key,value):
        self.attributes.append((key,value))
    
    def AddActivity(self,key,value):
        self.activities.append((key,value))

class SelectTemplateDialog(forms.Dialog[bool]):
    def __init__(self,obj):
        self.object = obj
        self.Title = "Select Template"
        self.templateChoice = []
        self.Resizable = False
        self.Padding = drawing.Padding(10)
        for tmpl in templates:
            self.templateChoice.append(tmpl.name)
        self.rGroup = forms.RadioButtonList()
        self.rGroup.DataStore = self.templateChoice
        self.rGroup.Orientation = forms.Orientation.Vertical
        self.rGroup.SelectedIndex = 0
        self.rGroup.SelectedIndexChanged += self.UpdateAttribute
        self.layoutChoice = forms.DynamicLayout()
        self.layoutChoice.Spacing = drawing.Size(5, 5)
        self.layoutChoice.AddRow(self.rGroup)
        self.layoutChoice.Padding = drawing.Padding(10)
        self.layout = forms.DynamicLayout()
        self.layout.Spacing = drawing.Size(5, 5)
        self.layout.Padding = drawing.Padding(10)
        self.layoutAttribute = forms.DynamicLayout()
        self.layoutAttribute.Spacing = drawing.Size(5, 5)
        self.layoutAttribute.Padding = drawing.Padding(10)
        self.layoutAttribute.AddRow(forms.Label(Text = "Attributes"))
        self.layoutAttributeTextBox = []
        for attr in templates[self.rGroup.SelectedIndex].attributes:
            textBox = forms.TextBox(Text = attr[1])
            self.layoutAttribute.AddRow(forms.Label(Text = attr[0]),textBox)
            self.layoutAttributeTextBox.append(textBox)
        if len(templates[self.rGroup.SelectedIndex].attributes) < maxAttributes:
            for i in range(len(templates[self.rGroup.SelectedIndex].attributes), maxAttributes):
                nLabel = forms.Label()
                #nLabel.Visible = False
                nText = forms.TextBox()
                self.layoutAttributeTextBox.append(nText)
                nText.Enabled = False
                self.layoutAttribute.AddRow(nLabel,nText)
        
        self.layoutActivity = forms.DynamicLayout()
        self.layoutActivity.Spacing = drawing.Size(5, 5)
        self.layoutActivity.Padding = drawing.Padding(10)
        self.layoutActivity.AddRow(forms.Label(Text = "Activity"))
        self.layoutActivityTextBox = []
        for act in templates[self.rGroup.SelectedIndex].activities:
            textBox = forms.TextBox(Text = act[1])
            self.layoutActivity.AddRow(forms.Label(Text = act[0]),textBox)
            self.layoutActivityTextBox.append(textBox)
        self.layoutActivity.AddSpace()
        
        #self.layoutAttribute.AddRow(None)
        self.layout.AddRow(self.layoutChoice,self.layoutAttribute,self.layoutActivity,self.layoutActivity)
        #cc = self.layoutAttribute.Children
        #print cc[0]
        #layout.AddColumn(layoutAttribute)
        # Create the default button
        self.DefaultButton = forms.Button(Text = 'Save')
        self.DefaultButton.Click += self.OnOKButtonClick
        
        # Create the abort button
        self.AbortButton = forms.Button(Text = 'Cancel')
        self.AbortButton.Click += self.OnCloseButtonClick
        buttonLayout = forms.DynamicLayout()
        
        buttonLayout.Spacing = drawing.Size(5, 5)
        buttonLayout.Padding = drawing.Padding(10)
        buttonLayout.AddRow(self.DefaultButton,self.AbortButton)
        self.layout.AddRow(None,buttonLayout)
        
        self.Content = self.layout
        
    def OnCloseButtonClick(self, sender, e):
        #self.m_textbox.Text = ""
        self.Close(False)
        
            # OK button click handler
    def OnOKButtonClick(self, sender, e):
        #if self.m_textbox.Text == "":
            #self.Close(False)
        #else:
        for obj in self.object:
            rs.SetUserText(obj,"ObjectType",templates[self.rGroup.SelectedIndex].name)
            print len(templates[self.rGroup.SelectedIndex].attributes)
            print len(self.layoutAttributeTextBox)
            for (attr,textBox) in zip(templates[self.rGroup.SelectedIndex].attributes,self.layoutAttributeTextBox):
                rs.SetUserText(obj,"Attribute."+attr[0],textBox.Text)
            for (act,textBox) in zip(templates[self.rGroup.SelectedIndex].activities,self.layoutActivityTextBox):
                rs.SetUserText(obj,"Activity."+act[0],textBox.Text)
        self.Close(True)
        
    def UpdateAttribute(self,sender,e):
        print "asooooooooooooooooo"
        #forms.DynamicLayout.Remove(
        layout = forms.DynamicLayout()
        layout.Spacing = drawing.Size(5, 5)
        layout.Padding = drawing.Padding(10)
        self.layoutAttribute = forms.DynamicLayout()
        self.layoutAttribute.Spacing = drawing.Size(5, 5)
        self.layoutAttribute.Padding = drawing.Padding(10)
        self.layoutAttribute.AddRow(forms.Label(Text = "Attributes"))
        self.layoutAttributeTextBox = []
        for attr in templates[self.rGroup.SelectedIndex].attributes:
            textBox = forms.TextBox(Text = attr[1])
            self.layoutAttribute.AddRow(forms.Label(Text = attr[0]),textBox)
            self.layoutAttributeTextBox.append(textBox)
        if len(templates[self.rGroup.SelectedIndex].attributes) < maxAttributes:
            for i in range(len(templates[self.rGroup.SelectedIndex].attributes), maxAttributes):
                nLabel = forms.Label()
                #nLabel.Visible = False
                nText = forms.TextBox()
                self.layoutAttributeTextBox.append(nText)
                nText.Enabled = False
                self.layoutAttribute.AddRow(nLabel,nText)
        
        
        self.layoutActivity = forms.DynamicLayout()
        self.layoutActivity.Spacing = drawing.Size(5, 5)
        self.layoutActivity.Padding = drawing.Padding(10)
        self.layoutActivity.AddRow(forms.Label(Text = "Activity"))
        self.layoutActivityTextBox = []
        for act in templates[self.rGroup.SelectedIndex].activities:
            textBox = forms.TextBox(Text = act[1])
            self.layoutActivity.AddRow(forms.Label(Text = act[0]),textBox)
            self.layoutActivityTextBox.append(textBox)
        self.layoutActivity.AddSpace()
        
        layout.AddRow(self.layoutChoice,self.layoutAttribute,self.layoutActivity)
        print "assddd22"
        print self.layout.Size
        #self.Size.Height += 28
        print self.Size
        #drawing.Size.
        #layout.UpdateBindings()
        #forms.DynamicLayout.
        #layout.Invalidate(False)
        print str(layout.Height) + " "+str(layout.Width)
        buttonLayout = forms.DynamicLayout()
        
        buttonLayout.Spacing = drawing.Size(5, 5)
        buttonLayout.Padding = drawing.Padding(10)
        buttonLayout.AddRow(self.DefaultButton,self.AbortButton)
        layout.AddRow(None,buttonLayout)
        self.Content = layout
        self.layout = layout
        #self.Invalidate(False)
        #self.Initialize()
        #print "opeeeekkkk "+str(self.rGroup.SelectedIndex)
        #self.layoutAttribute.

class AttributeDialog(forms.Dialog[bool]):

    # Dialog box Class initializer
    def __init__(self,obj):
    # Initialize dialog box
        self.object = obj
        self.Title = 'Object Info'
        self.Padding = drawing.Padding(10)
        self.Resizable = False
 
        #keyStrings = rs.GetUserText(obj)

        self.keys = rs.GetUserText(obj[0])
        #self.m_attributeValues = []
        self.m_attributeLabels = []
        self.m_attributeTextboxes = []
        
        #self.m_activityValues = []
        self.m_activityLabels = []
        self.m_activityTextboxes = []

        # Create a table layout and add all the controls
        self.layout = forms.DynamicLayout()
        self.layout.Spacing = drawing.Size(5, 5)
        self.layoutAttribute = forms.DynamicLayout()
        self.layoutAttribute.Spacing = drawing.Size(5, 5)
        self.layoutActivity = forms.DynamicLayout()
        self.layoutActivity.Spacing = drawing.Size(5, 5)
        
        self.layoutAttribute.AddRow(forms.Label(Text = "Attribute:"))
        self.layoutActivity.AddRow(forms.Label(Text = "Activity:"))
        for (i,key) in enumerate(self.keys):
            if key == "ObjectType":
                self.layout.AddRow(forms.Label(Text = ("Object Type: " + rs.GetUserText(obj[0],key))))
            elif key.startswith("Attribute"):
                textBox = forms.TextBox(Text = rs.GetUserText(obj[0],key))
                label = forms.Label(Text = key[10:])
                self.layoutAttribute.AddRow(label,textBox)
                self.m_attributeLabels.append(label)
                self.m_attributeTextboxes.append(textBox)
            elif key.startswith("Activity"):
                textBox = forms.TextBox(Text = rs.GetUserText(obj[0],key))
                label = forms.Label(Text = key[9:])
                self.layoutActivity.AddRow(label,textBox)
                self.m_activityLabels.append(label)
                self.m_activityTextboxes.append(textBox)
                
        self.layoutAttribute.AddSpace()
        self.layoutActivity.AddSpace()
        self.layout.AddRow(self.layoutAttribute,self.layoutActivity)
        # Create the default button
        self.DefaultButton = forms.Button(Text = 'Save')
        self.DefaultButton.Click += self.OnOKButtonClick
        
        # Create the abort button
        self.AbortButton = forms.Button(Text = 'Cancel')
        self.AbortButton.Click += self.OnCloseButtonClick
        
        #for (label,text) in zip(self.m_labels,self.m_textboxes):
            #layout.AddRow(label, text)
        self.layout.AddRow(None) # spacer
        self.layout.AddRow(self.DefaultButton, self.AbortButton)
        
        # Set the dialog content
        self.Content = self.layout
    # Close button click handler
    def OnCloseButtonClick(self, sender, e):
        #self.m_textbox.Text = ""
        self.Close(False)
        
            # OK button click handler
    def OnOKButtonClick(self, sender, e):
        #if self.m_textbox.Text == "":
            #self.Close(False)
        #else:
        for obj in self.object:
            #rs.SetUserText(obj,"ObjectType",templates[self.rGroup.SelectedIndex].name)
            #print len(templates[self.rGroup.SelectedIndex].attributes)
            #print len(self.layoutAttributeTextBox)
            for (attr,textBox) in zip(self.m_attributeLabels,self.m_attributeTextboxes):
                rs.SetUserText(obj,"Attribute."+attr.Text,textBox.Text)
            for (act,textBox) in zip(self.m_activityLabels,self.m_activityTextboxes):
                rs.SetUserText(obj,"Activity."+act.Text,textBox.Text)
        self.Close(True)
        
class AgentPropertiesDialog(forms.Dialog[bool]):
    # Dialog box Class initializer
    def __init__(self,obj):
        self.object = obj
        self.Title = "Agent Properties"
        self.layout = forms.DynamicLayout()
        self.layout.Spacing = drawing.Size(5, 5)
        self.layout.Padding = drawing.Padding(10)
        self.layout.AddRow(forms.Label(Text = "There will be agent properties here"))
        self.layout.AddSpace()
        # Create the default button
        self.DefaultButton = forms.Button(Text = 'OK')
        self.DefaultButton.Click += self.OnOKButtonClick
        self.layout.AddRow(None,self.DefaultButton)
        
        self.Content = self.layout
        
    
    # OK button click handler
    def OnOKButtonClick(self, sender, e):
        #if self.m_textbox.Text == "":
            #self.Close(False)
        #else:
        self.Close(True)
        
class MyComponent(component):
    def __init__(self):
        self.selectedObject = None
        self.isAgentSelected = False
        #self.templates = []
    
    def LoadTemplateCSV(self,filename):
        if not filename:
            return
        with open(filename) as csvfile:
            reader = csv.reader(csvfile)
            newTemplate = False
            attributeSession = False
            activitySession = False
            curTemplate = None
            attributeCount = 0
            global maxAttributes
            for row in reader:
                if row[0] == "Object":
                    attributeCount = 0
                    curTemplate = ObjectTemplate(row[1])
                    newTemplate = True
                elif row[0] == "Type":
                    attributeSession = (row[1] == "Attributes")
                    activitySession = (row[1] == "Activity")
                elif row[0] == "EndObject":
                    newTemplate = False
                    attributeSession = False
                    activitySession = False
                    templates.append(curTemplate)
                    maxAttributes = max(maxAttributes,attributeCount)
                    #curTemplate = None
                elif attributeSession:
                    curTemplate.AddAttribute(row[0],row[1])
                    attributeCount += 1
                elif activitySession:
                    curTemplate.AddActivity(row[0],row[1])
                    
    def RunScript(self, counter,reset):
        if reset:
            return False
        """Provides a scripting component.
            Inputs:
                x: The x script variable
                y: The y script variable
            Output:
                a: The a output variable"""
        
        __author__ = "andri.setiawan"
        __version__ = "2020.05.03"
        anySelected = False
        if len(templates) == 0:
            cFPath = ghenv.Component.OnPingDocument().FilePath
            cpath = cFPath[0:cFPath.rfind('\\')+1]
            my_path = cpath+'..\\res\\templates.csv'
            self.LoadTemplateCSV(my_path)
            
            
        
        sc.doc = rh.RhinoDoc.ActiveDoc
        #rh.DocObjects.Tables.ObjectTable.
        objList = rh.DocObjects.Tables.ObjectTable.GetSelectedObjects(sc.doc.Objects,False,False)
        sc.doc=ghdoc
        
        #print objList
        firstObject = None
        
        objectSelection = []
        keepGroup = []
        keepObject = []
        for i,obj in enumerate(objList):
            if i == 0:
                firstObject = obj
                keepGroup = firstObject.Attributes.GetGroupList()
            #if i == 0:
                #firstObject = obj
                #usrData = rs.GetUserText(obj)
                #dialog = AttributeDialog(obj)
                #rc = dialog.ShowModal(Rhino.UI.RhinoEtoApp.MainWindow)
                #self.selectedObject = obj
            #break
            else:
                objectSelection.append(obj)
            
            
        keepObject.append(firstObject)
        
        if keepGroup != None and len(keepGroup) != 0:
            for groupId in keepGroup:
                for obj in objectSelection:
                    objGroup = obj.Attributes.GetGroupList()
                    if objGroup != None and groupId in objGroup:
                        keepObject.append(obj)
            
        if firstObject:
            if self.selectedObject != firstObject:
                userData = rs.GetUserText(firstObject)
                print "usera"
                print userData
                hasTemplateData = False
                if len(userData) > 0:
                    hasTemplateData = ("ObjectType" in userData)
                #print hasTempla
                if hasTemplateData:
                    dialog = AttributeDialog(keepObject)
                elif ("LiveAgent" in userData):
                    dialog = AgentPropertiesDialog(firstObject)
                    self.isAgentSelected = True
                else:
                    dialog = SelectTemplateDialog(keepObject)
                rc = dialog.ShowModal(Rhino.UI.RhinoEtoApp.MainWindow)
                self.selectedObject = firstObject
        else:
            self.selectedObject = None
            self.isAgentSelected = False
        #Rhino.DocObjects.CurveObject.I
        if firstObject:
            rh.DocObjects.Tables.ObjectTable.UnselectAll(rh.RhinoDoc.ActiveDoc.Objects)
            #for obj in keepObject:
                #rh.DocObjects.Tables.ObjectTable.Select(rh.RhinoDoc.ActiveDoc.Objects,obj.Id,True,True)
        anySelected = (firstObject != None) and not self.isAgentSelected
        # return outputs if you have them; here I try it for you:
        return anySelected
# ---------- end checkselectedobject ----------
agentgenerator = GhPythonScript(agentPos=initial_location, initialState=initial_state, reset=reset)  # -> agentList; inputs agentPos: list of Point3d, initialState: list of Int32, reset: Boolean
# ---------- agentgenerator: Python ----------
from ghpythonlib.componentbase import executingcomponent as component
import Grasshopper, GhPython
import System
import Rhino
import rhinoscriptsyntax as rs
import sys
import itertools
from Rhino.Geometry import Point3d

cFPath = ghenv.Component.OnPingDocument().FilePath
cpath = cFPath[0:cFPath.rfind('\\')+1]
my_path = cpath+'..\source'
if not my_path in sys.path:
    sys.path.append(my_path)

import Agent
Agent = reload(Agent)

class MyComponent(component):
    def __init__(self):
        self.isRun = False
        self.agentList = None
        self.isAgentInitialized = False
        
    def InitalizeAgent(self, agentPos,initialState):
        self.agentList = []
        for index,(pos,state) in enumerate(itertools.izip_longest(agentPos,initialState)):
            #agent = Agent(pos)
            if index < len(agentPos):
                tState = Agent.STATE_IDLE
                if index < len(initialState):
                    tState = state
                #print pos
                agent = Agent.Agent(pos,Point3d(0,0,0),index,state)
                self.agentList.append(agent)
                print agent.pos
        self.isAgentInitialized = True
        
    def RunScript(self, agentPos, initialState, reset):
        print reset
        if reset:
            self.isAgentInitialized = False
            return None
            
        if (not self.isRun) and (not reset):
            self.isRun = True
            self.agentList = None
            
        if not self.isAgentInitialized:
            self.InitalizeAgent(agentPos, initialState)
        """Provides a scripting component.
            Inputs:
                x: The x script variable
                y: The y script variable
            Output:
                a: The a output variable"""
        
        __author__ = "remote"
        __version__ = "2020.03.24"
        
        import rhinoscriptsyntax as rs
        
        #for index,(pos,state) in enumerate(itertools.izip_longest(agentPos,initialState)):
            #agent = Agent(pos)
            #if index < len(agentPos):
                #tState = Agent.STATE_IDLE
                #if index < len(initialState):
                    #tState = state
                #print pos
                #agent = Agent.Agent(pos,Point3d(0,0,0),state)
                #agentList.append(agent)
        
        # return outputs if you have them; here I try it for you:
        return self.agentList
# ---------- end agentgenerator ----------
rec = Rectangle({Plane=PlaneXY(7.852260266, 7.485382809, 0), Size=Domain2(u=-8.071463562..8.071463562, v=-7.6184106..7.6184106)})
gridgenerator = GhPythonScript(area=rec, reset=reset)  # -> gridArea, topPos, posibleTarget, entryPoints, additionalWeight, polina; inputs counter: Int32, reset: Boolean
# ---------- gridgenerator: Python ----------
from ghpythonlib.componentbase import executingcomponent as component
import Grasshopper, GhPython
import System
import Rhino as rh
import rhinoscriptsyntax as rs
import scriptcontext as sc
import math
import Rhino.Geometry as rg
import sys
from Rhino.Geometry import Point3d,Point,NurbsSurface

cFPath = ghenv.Component.OnPingDocument().FilePath
cpath = cFPath[0:cFPath.rfind('\\')+1]
my_path = cpath+'..\source'
if not my_path in sys.path:
    sys.path.append(my_path)

import Target
Target = reload(Target)

import Agent
Agent = reload(Agent)

import EntryPoint
EntryPoint = reload(EntryPoint)

STATE_FREE = 0
STATE_BLOCKED = 1
STATE_ENTRY = 2


class MyComponent(component):
    
    def __init__(self):
        self.NEIGHBOR_CHECK = []
        self.NEIGHBOR_DIS = 2
        self.WALL_DISTANCE = 0.15
        self.gridSize = 0.08
        self.grids = None
        self.gridInitialized = False
        self.topPos = None
        self.possibleTarget = []
        self.entryPoint = []
        self.isRun = False
        self.additionalWeight = None
        #self.polina = []
    
    def GenerateNeighborCheck(self):
        self.NEIGHBOR_CHECK = []
        for i in range(-self.NEIGHBOR_DIS,self.NEIGHBOR_DIS+1):
            for j in range(-self.NEIGHBOR_DIS,self.NEIGHBOR_DIS+1):
                if i == 0 and j == 0:
                    continue
                self.NEIGHBOR_CHECK.append((i,j))
        
    def InitializeGrid(self,area):
        import rhinoscriptsyntax as rs
        self.GenerateNeighborCheck()
        
        sc.doc = rh.RhinoDoc.ActiveDoc
        groundIndex = sc.doc.Layers.Find("ARS-LANTAI",True)
        sc.doc = ghdoc
        
        entryPointObject = []
        targetPointObject = []
        
        #self.polina = []
        #get nurbscurve or rectangle
        rectArea = rs.coercecurve(area)
        
        if rectArea.Points[0].Location[0] < rectArea.Points[2].Location[0]:
            minX = rectArea.Points[0].Location[0]
            maxX = rectArea.Points[2].Location[0]
        else:
            minX = rectArea.Points[2].Location[0]
            maxX = rectArea.Points[0].Location[0]
        
        if rectArea.Points[0].Location[1] < rectArea.Points[2].Location[1]:
            minY = rectArea.Points[0].Location[1]
            maxY = rectArea.Points[2].Location[1]
        else:
            minY = rectArea.Points[2].Location[1]
            maxY = rectArea.Points[0].Location[1]
        
        #get width/height of the area and gridCount
        """diffW"""
        gridCountW = abs(int(math.ceil(maxX/self.gridSize)) - int(math.floor(minX/self.gridSize)))
        #gridCountW =  int(math.ceil(abs(diffW)/self.gridSize))
        
        #diffH = rectArea.Points[0].Location[1] - rectArea.Points[2].Location[1]
        gridCountH = abs(int(math.ceil(maxY/self.gridSize)) - int(math.floor(minY/self.gridSize)))
        #gridCountH =  int(math.ceil(abs(diffH)/self.gridSize))
        
        #initialize grid array
        self.grids = [[STATE_FREE for i in range(gridCountH)]for j in range(gridCountW)]
        self.additionalWeight = [[0 for i in range(gridCountH)]for j in range(gridCountW)]
        
        gridStartX = float(math.floor(minX/self.gridSize)) * self.gridSize
        gridStartY = float(math.ceil(maxY/self.gridSize)) * self.gridSize
                
        if rectArea:
            rh.DocObjects.Tables.ObjectTable.UnselectAll(rh.RhinoDoc.ActiveDoc.Objects)
            #get objects inside the region
            rc,pl = rectArea.TryGetPolyline()
            view = sc.doc.Views.ActiveView.ActiveViewport            
            objectList = rh.RhinoDoc.ActiveDoc.Objects.FindByCrossingWindowRegion(view,pl,True,rh.DocObjects.ObjectType.AnyObject)#rh.DocObjects.ObjectType.Curve|rh.DocObjects.ObjectType.Point|rh.DocObjects.ObjectType.InstanceDefinition)
            
            #rh.DocObjects.RhinoObject.ObjectType
            
            #print "gourd"
            for oi in objectList:
                #if oi.GetType() != rh.DocObjects.CurveObject:
                    #print oi.GetType()
                    #print oi.Id
                    #print oi.Geometry.GetBoundingBox(rh.Geometry.Plane.WorldXY)
                    #rh.Geometry.InstanceReferenceGeometry.GetBoundingBox(rh.Geometry.Plane.WorldXY)
                    #rh.DocObjects.InstanceObject.
                #print oi.GetType()
                #rs.
                #rh.DocObjects.ObjectType.AnyObject.Curve(
                #print rs.GetUserText(oi,"chair")
                #print rs.GetUserText(oi,"Entry")
                #print rs.GetUserText(oi,"Target")
                if oi.Attributes.LayerIndex == groundIndex:
                    continue
                
                if oi.ObjectType == rh.DocObjects.ObjectType.Point:
                    #pp = rh.DocObjects.PointObject.PointGeometry
                    #pp = oi.PointGeometry
                    #pr = rh.Geometry.Point.Location
                    #pr = pp.Location
                    #print (pp.GetType())
                    #print pp
                    #print pr
                    if rs.GetUserText(oi,"Target") != None:
                        target = Target.Target(oi.PointGeometry.Location)
                        targetPointObject.append(oi)
                        specific = rs.GetUserText(oi,"Specific")
                        if specific != None:
                            specList = specific.split(',')
                            for spec in specList:
                                target.setSpecificAgent(int(spec))
                        activity = rs.GetUserText(oi,"Activity")
                        if activity != None:
                            actList = activity.split(',')
                            for act in actList:
                                target.setActivity(act)
                        self.possibleTarget.append(target)
                    if rs.GetUserText(oi,"Entry") != None:
                        entryPointObject.append(oi)
                        self.entryPoint.append(EntryPoint.EntryPoint(oi.PointGeometry.Location))
                    continue
                #print oi.ObjectType
                if oi.GetType() == rh.DocObjects.InstanceObject:
                    bbox = oi.Geometry.GetBoundingBox(rh.Geometry.Plane.WorldXY)
                else:
                    curve = oi.CurveGeometry
                    if not curve:
                        #print oi.GetType()
                        continue
                    bbox = curve.GetBoundingBox(True)
                if not bbox.IsValid: continue

                #print "World min:", bbox.Min
                #print "World max:", bbox.Max
                
                xMin = int(((float(math.floor((bbox.Min.X - self.WALL_DISTANCE)/self.gridSize)) * self.gridSize) - gridStartX)/self.gridSize)
                xMax = int(((float(math.ceil((bbox.Max.X + self.WALL_DISTANCE)/self.gridSize)) * self.gridSize) - gridStartX)/self.gridSize)
                #rh.DocObjects.CurveObject.Geometry.
                yMin = int((gridStartY - (float(math.floor((bbox.Min.Y - self.WALL_DISTANCE)/self.gridSize)) * self.gridSize))/self.gridSize)
                yMax = int((gridStartY - (float(math.ceil((bbox.Max.Y + self.WALL_DISTANCE)/self.gridSize)) * self.gridSize))/self.gridSize)
            
                for i in range(yMax,yMin+1):
                    for j in range(xMin,xMax+1):
                    #rg.Rectangle3d.
                        if i >= gridCountH or j >= gridCountW or i < 0 or j < 0:
                            continue
                        cRect = rh.Geometry.Rectangle3d(rh.Geometry.Plane.WorldXY,rg.Point3d(gridStartX+(j*self.gridSize),gridStartY-(i*self.gridSize),0),rg.Point3d(gridStartX+((j+1)*self.gridSize),gridStartY-((i+1)*self.gridSize),0))
                    #cRect = rh.Geometry.Rectangle3d(rh.Geometry.Plane.WorldXY,rg.Point3d(rectArea.Points[0].Location[0]+(j*self.gridSize),rectArea.Points[0].Location[0]+(i*self.gridSize),0),rg.Point3d(rectArea.Points[0].Location[0]+((j+1)*self.gridSize),rectArea.Points[0].Location[0]+((i+1)*self.gridSize),0))
                        #print cRect.Area
                    #for oi in objectList:
                        #if oi.ObjectType == rh.DocObjects.ObjectType.Point:
                            #continue
                        #rh.Geometry.Rectangle3d.Po
                        if oi.GetType() == rh.DocObjects.InstanceObject:
                            self.grids[j][i] = STATE_BLOCKED
                            #self.polina.append(cRect)
                        else:
                            inter = rg.Intersect.Intersection.CurveCurve(oi.CurveGeometry,cRect.ToNurbsCurve(),self.WALL_DISTANCE,0)
                            if inter:
                                self.grids[j][i] = STATE_BLOCKED
                                #self.polina.append(cRect)
                            #sf = NurbsSurface.CreateFromCorners(rg.Point3d(gridStartX+(j*self.gridSize),gridStartY-(i*self.gridSize),0),rg.Point3d(gridStartX+((j+1)*self.gridSize),gridStartY-((i+1)*self.gridSize),0))
                            
        #for ep in self.entryPoint:
            
            """print ep
            print str(gridEpX)+" "+str(gridEpY)
            print str(len(self.grids))+" "+str(len(self.grids[0]))
            
            for fGrid in [(0, -1), (0, 1), (-1, 0), (1, 0), (-1, -1), (-1, 1), (1, -1), (1, 1)]:
                self.grids[gridEpX+fGrid[0]][gridEpY+fGrid[1]] = STATE_FREE"""
            #print "aaaaaa"
        print "maze pure"
        for i in range(len(self.grids[0])):
            s = ""
            for j in range(len(self.grids)):
                s+=(str(self.grids[j][len(self.grids[0]) - i -1])+" ")
            print s
        for (epObject,ep) in zip(entryPointObject,self.entryPoint):
            gridEpX = int(math.floor((ep.pos.X - gridStartX)/self.gridSize))
            gridEpY = int(math.floor((gridStartY - ep.pos.Y)/self.gridSize))
            
            self.grids[gridEpX][gridEpY] = STATE_ENTRY
            epGroupList = epObject.GetGroupList()
            #print epGroupList
            #rh.DocObjects.PointObject.I
            dir = rs.GetUserText(epObject,"Direction")
            print "onggrid "+str(gridEpX)+","+str(gridEpY)
            print dir
            checker = 5
            if dir == "LEFT":
                for i in range(-1,-checker,-1):
                    print "check grid "+str(gridEpX + i)+ "," +str(gridEpY)+" valero "+str(self.grids[gridEpX + i][gridEpY])
                    if self.grids[gridEpX + i][gridEpY] == STATE_BLOCKED:
                        self.grids[gridEpX + i][gridEpY] = STATE_FREE
                    elif self.grids[gridEpX + i][gridEpY] == STATE_FREE:
                        break
            elif dir == "RIGHT":
                print "check grid "+str(gridEpX + i)+ "," +str(gridEpY)
                for i in range(1,checker):
                    if self.grids[gridEpX + i][gridEpY] == STATE_BLOCKED:
                        self.grids[gridEpX + i][gridEpY] = STATE_FREE
                    elif self.grids[gridEpX + i][gridEpY] == STATE_FREE:
                        break
            elif dir == "UP":
                print "check grid "+str(gridEpX)+ "," +str(gridEpY+i)
                for i in range(-1,-checker,-1):
                    if self.grids[gridEpX][gridEpY + i] == STATE_BLOCKED:
                        self.grids[gridEpX][gridEpY + i] = STATE_FREE
                    elif self.grids[gridEpX][gridEpY + i] == STATE_FREE:
                        break
            elif dir == "DOWN":
                print "check grid "+str(gridEpX)+ "," +str(gridEpY+i)
                for i in range(1,checker):
                    if self.grids[gridEpX][gridEpY + i] == STATE_BLOCKED:
                        self.grids[gridEpX][gridEpY + i] = STATE_FREE
                    elif self.grids[gridEpX][gridEpY + i] == STATE_FREE:
                        break
            for (tObject,target) in zip(targetPointObject,self.possibleTarget):
                
                #entrypoint and targetpoint is similar
                #print epObject.GetType()
                #print epObject.Geometry.GetType()
                print str(epObject.Geometry.Location.X)+" "+str(epObject.Geometry.Location.Y)+" "+str(epObject.Geometry.Location.Z)
                print str(tObject.Geometry.Location.X)+" "+str(tObject.Geometry.Location.Y)+" "+str(tObject.Geometry.Location.Z)
                #rh.DocObjects.PointObject.Geometry
                if epObject.Geometry.Location == tObject.Geometry.Location:
                    ep.target = target
                    break
                    
                #entrypoint different with targetpoint
                targetGroupList = tObject.GetGroupList()
                counter = 0
                #target and entry point must have all their group similar
                if targetGroupList == None or epGroupList == None:
                    continue
                for tGroup in targetGroupList:
                    #print "tiger "+str(tGroup)
                    for eGroup in epGroupList:
                        #print "eger "+str(eGroup)
                        if tGroup == eGroup:
                            counter +=1
                            break
                if counter == len(targetGroupList):
                    ep.target = target
                    break
            print "entrrar"
            print ep.pos
            print ep.target
            
            print "done dion"
            
        """for tgt in self.possibleTarget:
            print tgt.targetPoint
        
        print len(self.grids[0])
        print len(self.grids)
        print gridCountH
        print gridCountW"""
        print "lenin "+str(len(self.NEIGHBOR_CHECK))
        for k in self.NEIGHBOR_CHECK:
            print k
        
        for i in range(len(self.grids[0])):
            for j in range(len(self.grids)):
                for neighbor in self.NEIGHBOR_CHECK:
                    toCheckX = i + neighbor[0]
                    toCheckY = j + neighbor[1]
                    #print "from "+str(j)+","+str(i)+" ceking diff "+str(neighbor)+ " become "+str(toCheckY)+","+str(toCheckX)
                    
                    #out of area
                    if (toCheckX < 0) or (toCheckX >= gridCountH) or (toCheckY < 0) or (toCheckY >= gridCountW):
                        continue
                    
                    #wall
                    if self.grids[j][i] == STATE_BLOCKED:
                        continue
                    
                    #already checked
                    #if self.additionalWeight[j][i] > 0:
                        #continue
                        
                    if self.grids[toCheckY][toCheckX] == STATE_BLOCKED:
                        self.additionalWeight[j][i] = max(self.additionalWeight[j][i],(self.NEIGHBOR_DIS - max(abs(neighbor[0]),abs(neighbor[1])) + 1) * self.gridSize * 100)
                    
        print "maze"
        for i in range(len(self.grids[0])):
            s = ""
            for j in range(len(self.grids)):
                s+=(str(self.grids[j][len(self.grids[0]) - i -1])+" ")
            print s
        print "weight"
        for i in range(len(self.grids[0])):
            s = ""
            for j in range(len(self.grids)):
                s+=(str(int(self.additionalWeight[j][len(self.additionalWeight[0]) - i -1]/10))+" ")
            print s
        self.gridInitialized = True
            
        self.topPos = Point3d(gridStartX,gridStartY,0)
        #rg.Mesh(
    
    def RunScript(self, area,counter,reset):
        gridArea = None
        topPos = None
        entryPoints = None
        """Provides a scripting component.
            Inputs:
                x: The x script variable
                y: The y script variable
            Output:
                a: The a output variable"""
        
        __author__ = "andri.setiawan"
        __version__ = "2020.03.16"
        
        
        import rhinoscriptsyntax as rs
        import sys
        
        if reset:
            self.gridInitialized = False
            self.isRun = False
            return None,None,None
        
        if (not self.isRun) and (not reset):
            self.isRun = True
            self.grids = None
            self.gridInitialized = False
            self.topPos = None
            self.possibleTarget = []
            self.entryPoint = []
            
        
        if not self.gridInitialized:
            self.InitializeGrid(area)
        
        """
        rectArea = rs.coercecurve(area)
        
        #gridDim1 = rectArea.Points[0][0] - rectArea.Points[2][0]
        
        #dd = rh.Geometry.ControlPoint.Location.
        diffW = rectArea.Points[0].Location[0] - rectArea.Points[2].Location[0]
        gridCountW =  int(math.ceil(abs(diffW)/self.gridSize))
        
        diffH = rectArea.Points[0].Location[1] - rectArea.Points[2].Location[1]
        gridCountH =  int(math.ceil(abs(diffH)/self.gridSize))
        
        
        print("grid count %d %d"%(gridCountW,gridCountH))
        
        self.grids = [[STATE_FREE for i in range(gridCountW)]for j in range(gridCountH)]
        
        if rectArea:
            rc,pl = rectArea.TryGetPolyline()
            view = sc.doc.Views.ActiveView.ActiveViewport
            
            objectList = rh.RhinoDoc.ActiveDoc.Objects.FindByCrossingWindowRegion(view,pl,True,rh.DocObjects.ObjectType.Curve)
            i = 0
            for oi in objectList:
                print "ojepk %d gu %s is %s" %(i,oi, oi.GetType())
                #rh.DocObjects.CurveObject.
                print oi.CurveGeometry
                objj  = oi.CurveGeometry.GetType()
                
                #rh.Geometry.Rectangle3d(
                
                #if objj == rh.Geometry.LineCurve:
                    #print oi.CurveGeometry.PointAtStart
                    #print oi.CurveGeometry.PointAtEnd
                    #for i in range(len(self.grids)):
                        #for j in range(len(self.grids[i])):
                            #rg.Rectangle3d.
                            #cRect = rh.Geometry.Rectangle3d(rh.Geometry.Plane.WorldXY,rg.Point3d(rectArea.Points[0].Location[0]+(i*self.gridSize),rectArea.Points[0].Location[0]+(j*self.gridSize),0),rg.Point3d(rectArea.Points[0].Location[0]+((i+1)*self.gridSize),rectArea.Points[0].Location[0]+((j+1)*self.gridSize),0))
                            #print cRect.Area
                            #inter = rg.Intersect.Intersection.CurveCurve(oi.CurveGeometry,cRect.ToNurbsCurve(),0.1,0)
                            #if inter:
                                #self.grids[i][j] = STATE_BLOCKED
                        #print self.grids[i]
                #else:
                    #obb=oi.CurveGeometry.Points
                    #for po in obb:
                        #print po.Location
                for i in range(len(self.grids)):
                    for j in range(len(self.grids[i])):
                        #rg.Rectangle3d.
                        cRect = rh.Geometry.Rectangle3d(rh.Geometry.Plane.WorldXY,rg.Point3d(rectArea.Points[0].Location[0]+(i*self.gridSize),rectArea.Points[0].Location[0]+(j*self.gridSize),0),rg.Point3d(rectArea.Points[0].Location[0]+((i+1)*self.gridSize),rectArea.Points[0].Location[0]+((j+1)*self.gridSize),0))
                        #print cRect.Area
                        inter = rg.Intersect.Intersection.CurveCurve(oi.CurveGeometry,cRect.ToNurbsCurve(),0.1,0)
                        if inter:
                            self.grids[i][j] = STATE_BLOCKED
                #print obb
                #crv = rs.coercecurve(oi.Id)
                #print crv
                #if crv:
                    #print crv.GetType()
                #print od
                i+=1
            for i in range(len(self.grids)):
                print self.grids[i]
        """
        # return outputs if you have them; here I try it for you:
        gridArea = self.grids
        topPos = self.topPos
        possibleTarget = self.possibleTarget
        entryPoints = self.entryPoint
        additionalWeight = self.additionalWeight
        return gridArea,topPos,possibleTarget,entryPoints,additionalWeight,None#self.polina
# ---------- end gridgenerator ----------
checkagent = BooleanToggle(False)
agentupdater = GhPythonScript(
    checkAgent=checkagent,
    anySelected=checkselectedobject,
    mArea=gridgenerator.gridArea,
    agent=agentgenerator,
    topPos=gridgenerator.topPos,
    possibleTarget=gridgenerator.posibleTarget,
    entryPoints=gridgenerator.entryPoints,
    additionalWeight=gridgenerator.additionalWeight,
    boundArea=rec)  # -> agentList, a, angle; inputs checkAgent: Boolean, mArea: list, agent: list, topPos: Point3d, possibleTarget: list, entryPoints: list, additionalWeight: list
# ---------- agentupdater: Python ----------
from ghpythonlib.componentbase import executingcomponent as component
import Grasshopper, GhPython
import System
import Rhino
import rhinoscriptsyntax as rs
import sys
from Rhino.Geometry import Point3d,Vector3f,Vector3d,Line,Polyline
import math
import scriptcontext as sc

cFPath = ghenv.Component.OnPingDocument().FilePath
print cFPath
cpath = cFPath[0:cFPath.rfind('\\')+1]
print cpath
my_path = cpath+'..\source'
if not my_path in sys.path:
    sys.path.append(my_path)

import Agent
Agent = reload(Agent)

import PathFinding
PathFinding = reload(PathFinding)

class MyComponent(component):
    def __init__(self):
        self.haveAgentList = False
        self.myAgent = None
        self.s = 0
        self.pointScreen = []
        self.mError = ""
    
    def RunScript(self,checkAgent, anySelected,mArea, agent,topPos,possibleTarget,entryPoints,additionalWeight,boundArea):
        import Agent
        #Agent = reload(Agent)
        PathFinding.Map.topPos = topPos
        PathFinding.Map.additionalWeight = additionalWeight
        angle = []
        #PathFinding.Map.liveBlock = []
        if not agent[0]:
            print "no agent"
            self.pointScreen = []
            self.myAgent = []
            PathFinding.Map.liveBlock = []
            return
        elif len(self.pointScreen) == 0:
            for i in range(len(agent)):
                point = Point3d(0,0,0)
                self.pointScreen.append(point)
                PathFinding.Map.liveBlock.append((0,0))
        a = None
        """Provides a scripting component.
            Inputs:
                x: The x script variable
                y: The y script variable
            Output:
                a: The a output variable"""
        if not self.myAgent:
            self.myAgent = agent
        PathFinding.Map.maze = mArea
        
        __author__ = "andri.setiawan"
        __version__ = "2020.03.21"
        
        import rhinoscriptsyntax as rs
        
        #if Agent.Agent.possibleTarget == None:
        Agent.Agent.possibleTarget = possibleTarget
        Agent.Agent.entryPointList = entryPoints
        Agent.Agent.agentList = agent
        #for tgt in possibleTarget:
            #print tgt
            #print tgt.targetPoint
        #print len(Agent.Agent.possibleTarget)
        #i = 0
        for (i,agt) in enumerate(self.myAgent):
            print "aloix "+str(i)
            if agt.target != None:
                print agt.target.targetPoint
            #print agt.state
            
            if not checkAgent:
                agt.setBoundArea(boundArea)
                pos = agt.update()
                self.UpdateViewAgent(agt)
            
                if len(PathFinding.Map.liveBlock) <= i:
                    PathFinding.Map.liveBlock.append(Agent.TranslateToGridPos(pos))
                else:
                    PathFinding.Map.liveBlock[i] = Agent.TranslateToGridPos(pos)
                self.pointScreen[i].X = pos.X
                self.pointScreen[i].Y = pos.Y
                self.pointScreen[i].Z = pos.Z
            
            angle.append(math.atan2(agt.moveDir.Y,agt.moveDir.X) - math.atan2(-1,0))
            
            #i+=1
            #if agt.state != 0:
                #print agt.myPath
            #print str(agt.state)+ " "+str(agt.waitTime)
            #print agt.pos
        #px,py = TranslateToGridPos(topPos,agent[0].pos)
        
        #print self.s
        self.s+=1
        #print py
        # return outputs if you have them; here I try it for you:
        a = self.pointScreen
        print a
        print angle
        return self.myAgent,a,angle
        
    def UpdateViewAgent(self,agent):
        curveBound = rs.coercecurve(agent.boundArea)
        print curveBound
        rc,pl = curveBound.TryGetPolyline()
        
        diagL = Vector3d.Subtract(Vector3d(curveBound.Points[0].Location),Vector3d(curveBound.Points[2].Location)).Length
        
        vec1 = rs.VectorRotate(agent.moveDir,-60,(0,0,1))
        vec1.Unitize()
        endl1 = Point3d.Add(agent.pos,(vec1*diagL))
        mLine1 = Line(agent.pos,endl1)
        
        vec2 = rs.VectorRotate(agent.moveDir,60,(0,0,1))
        vec2.Unitize()
        endl2 = Point3d.Add(agent.pos,(vec2*diagL))
        mLine2 = Line(agent.pos,endl2)
        #Line.to
        iSect1 = Rhino.Geometry.Intersect.Intersection.CurveCurve(curveBound,mLine1.ToNurbsCurve(),0,0)
        iSect2 = Rhino.Geometry.Intersect.Intersection.CurveCurve(curveBound,mLine2.ToNurbsCurve(),0,0)
        print "line1 "+str(mLine1.From)+" "+str(mLine1.To)
        print "line2 "+str(mLine2.From)+" "+str(mLine2.To)
        
        for inte in iSect1:
            point1 = inte.PointA
            
        for inte in iSect2:
            point2 = inte.PointA
            
        vpointList = []
        for poin in curveBound.Points:
            vect = Vector3d.Subtract(Vector3d(poin.Location),Vector3d(agent.pos))
            vect.Unitize()
            angle = math.degrees(math.atan2(vect.Y,vect.X)-math.atan2(vec1.Y,vec1.X))
            if angle >= 0 and angle <= 120:
                vpointList.append((vect,poin.Location))
        
        vpointList.sort(key = lambda x: math.degrees(math.atan2(x[0].Y,x[0].X)-math.atan2(vec1.Y,vec1.X)),reverse = True)
        
        #print vpointList
        pointList = []
        pointList.append(agent.pos)
        pointList.append(point2)
        for vpoint in vpointList:
            pointList.append(vpoint[1])
        pointList.append(point1)
        pointList.append(agent.pos)
        palo = Polyline(pointList)
        
        view = sc.doc.Views.ActiveView.ActiveViewport      
        agent.objectList = Rhino.RhinoDoc.ActiveDoc.Objects.FindByCrossingWindowRegion(view,palo,True,Rhino.DocObjects.ObjectType.InstanceReference)
        print agent.objectList

def TranslateToGridPos(topPos,pos):
    #print topPos
    #print pos
    gridX = int(math.ceil((pos.X - topPos.X)/0.1))
    gridY = int(math.ceil((topPos.Y - pos.Y)/0.1))
    return gridX,gridY
# ---------- end agentupdater ----------
python = GhPythonScript(x=agentupdater.agentList, y=c_script.C, reset=reset)  # -> a; inputs x: list, reset: Boolean
# ---------- python: Python ----------
from ghpythonlib.componentbase import executingcomponent as component
import Grasshopper, GhPython
import System
import Rhino
import rhinoscriptsyntax as rs
import sys

import System
import Rhino.UI
import Eto.Drawing as drawing
import Eto.Forms as forms

cFPath = ghenv.Component.OnPingDocument().FilePath
cpath = cFPath[0:cFPath.rfind('\\')+1]
my_path = cpath+'..\source'
if not my_path in sys.path:
    sys.path.append(my_path)
    
import Agent
Agent = reload(Agent)

class AgentInfo(forms.Form):
    def __init__(self,agent):
        self.myAgent = agent
        
        self.Title = "Agent Info"
        self.Padding = drawing.Padding(10)
        
        self.layout = forms.DynamicLayout()
        self.layout.Spacing = drawing.Size(5,5)
        self.layout.Padding = drawing.Padding(10)
        
        nLabel = forms.Label(Text = str(agent.pos))
        
        self.layout.AddRow(nLabel)
        
        self.Content = self.layout

class MyComponent(component):
    def __init__(self):
        self.myAgentInfo = None
        self.formCreated = False
        self.formShow = False
        
    def ShowForm(self):
        self.myAgentInfo.Show()
        self.formShow = True
    
    def InitForm(self,agent):
        self.myAgentInfo = forms.Form()
        #ferom = forms.Form()
        self.myAgentInfo.Title = "Agent Info"
        self.myAgentInfo.Padding = drawing.Padding(10)
        
        self.UpdateForm(agent)
        self.formCreated = True
        
    def UpdateForm(self,agent):
        layout = forms.DynamicLayout()
        layout.Spacing = drawing.Size(5,5)
        layout.Padding = drawing.Padding(10)
        
        if agent == None or len(agent) == 0 or agent[1] == None:
            nLabel = forms.Label(Text = "No Agent")
            layout.AddRow(nLabel)
        else:
            nLabel = forms.Label(Text = str(agent[1].pos))
            for obj in agent[1].objectList:
                nLabel = forms.Label(Text = str(obj.Id))
                layout.AddRow(nLabel)
        #layout.AddRow(nLabel)
        self.myAgentInfo.Content = layout
    
    def RunScript(self, x, y,reset):
        print reset
        if reset:
            self.formCreated = False
            self.formShow = False
            if self.myAgentInfo != None:
                self.myAgentInfo.Close()
            return None
        """Provides a scripting component.
            Inputs:
                x: The x script variable
                y: The y script variable
            Output:
                a: The a output variable"""
        
        __author__ = "andri.setiawan"
        __version__ = "2020.06.13"
        
        import rhinoscriptsyntax as rs
        
        if not self.formCreated:
            self.InitForm(x)
            
        
        #ferom.Show()
        self.UpdateForm(x)
        if not self.formShow:
            self.ShowForm()
        #forms.Form.Sh
        
        # return outputs if you have them; here I try it for you:
        return None
# ---------- end python ----------
python_2 = GhPythonScript(checkAgent=checkagent, agentList=agentupdater.agentList, location=agentupdater.a, angle=agentupdater.angle)  # -> a; inputs agentList: list, location: list of Point3d, angle: list
# ---------- python_2: Python ----------
from ghpythonlib.componentbase import executingcomponent as component
import Grasshopper, GhPython
import System
import Rhino
import rhinoscriptsyntax as rs
import scriptcontext as sc
from Rhino.Geometry import Plane,NurbsSurface,Point3d,Vector3d
import sys

cFPath = ghenv.Component.OnPingDocument().FilePath
print cFPath
cpath = cFPath[0:cFPath.rfind('\\')+1]
print cpath
my_path = cpath+'..\source'
if not my_path in sys.path:
    sys.path.append(my_path)

import Agent
Agent = reload(Agent)

class MyComponent(component):
    def __init__(self):
        self.isAgentBaked = False
        self.magel = []
        self.gugu = []
    
    def RunScript(self, checkAgent, agentList,location, angle):
        """Provides a scripting component.
            Inputs:
                x: The x script variable
                y: The y script variable
            Output:
                a: The a output variable"""
        
        __author__ = "andri.setiawan"
        __version__ = "2020.05.12"
        
        import rhinoscriptsyntax as rs
        
        halfSize = 0.3
        fullSize = halfSize*2
        if checkAgent:
            if not self.isAgentBaked:
                
                sc.doc = Rhino.RhinoDoc.ActiveDoc
                for (loc,agl) in zip(location,angle):
                    #loc = agent.pos
                    sf = NurbsSurface.CreateFromCorners(Point3d(loc.X - fullSize,loc.Y-fullSize,0),Point3d(loc.X,loc.Y-fullSize,0),Point3d(loc.X,loc.Y,0),Point3d(loc.X - fullSize,loc.Y,0))
                    #sf = NurbsSurface.CreateFromCorners(Point3d(loc.X - halfSize,loc.Y-halfSize,0),Point3d(loc.X+halfSize,loc.Y-halfSize,0),Point3d(loc.X+halfSize,loc.Y+halfSize,0),Point3d(loc.X - halfSize,loc.Y+halfSize,0))
                    sf.Rotate(agl,Vector3d(0,0,1),loc)
                    print agl
                    self.magel.append(agl)
                    plane = None
                    rc,plane = sf.TryGetPlane(0)
                    #Rhino.RhinoDoc.ActiveDoc.Objects.AddPictureFrame(
                    #sc.doc.Objects.AddSurface(sf)
                    guid = sc.doc.Objects.AddPictureFrame(plane,"D:\Project\omae\walki.png",True,halfSize*2,halfSize*2,False,True)
                    rs.SetUserText(guid,"LiveAgent","--")
                    self.gugu.append(guid)
                self.isAgentBaked = True
                sc.doc = ghdoc
        else:
            if self.isAgentBaked:
                self.isAgentBaked = False
        for agl in self.magel:
            print agl
        for gu in self.gugu:
            print gu
        # return outputs if you have them; here I try it for you:
        return None
# ---------- end python_2 ----------
animmanager = GhPythonScript(location=agentupdater.a, angle=agentupdater.angle)  # -> surface, image; inputs location: list of Point3d, angle: list
# ---------- animmanager: Python ----------
from ghpythonlib.componentbase import executingcomponent as component
import Grasshopper, GhPython
import System
import Rhino
import rhinoscriptsyntax as rs
from Rhino.Geometry import Surface,Plane,NurbsSurface,Point3d,Vector3d

class MyComponent(component):
    def __init__(self):
        self.testAngle = 0
        cFPath = ghenv.Component.OnPingDocument().FilePath
        cpath = cFPath[0:cFPath.rfind('\\')+1]
        self.imgPath = []
        self.imgPath.append(cpath+'..\\res\\m5.png')
        self.imgPath.append(cpath+'..\\res\\w1.png')
        
    def RunScript(self, location,angle):
        """Provides a scripting component.
            Inputs:
                x: The x script variable
                y: The y script variable
            Output:
                a: The a output variable"""
        
        __author__ = "andri.setiawan"
        __version__ = "2020.05.11"
        
        import rhinoscriptsyntax as rs
        surfaces = []
        halfSize = 0.2
        print location
        for (loc,agl) in zip(location,angle):
            #print loc
            #print loc - Point3d(1,1,1)
            if loc != None:
                sf = NurbsSurface.CreateFromCorners(Point3d(loc.X - halfSize,loc.Y-halfSize,0),Point3d(loc.X+halfSize,loc.Y-halfSize,0),Point3d(loc.X+halfSize,loc.Y+halfSize,0),Point3d(loc.X - halfSize,loc.Y+halfSize,0))
                #print Plane.ZAxis.GetType()
                sf.Rotate(agl,Vector3d(0,0,1),loc)
                surfaces.append(sf)
                #NurbsSurface.Rotate(
                #rs.RotateObject(sf.Id
                #rs.RotatePlane(sf,self.testAngle,(loc.X,loc.Y,loc.Z))
        imag = "D:\Project\omae\walki.png"
        self.testAngle+=0.5
        # return outputs if you have them; here I try it for you:
        return surfaces,self.imgPath
# ---------- end animmanager ----------
previewmat = CustomPreviewMaterials(Geometry=animmanager.surface, DiffuseColor=RGBA(255, 255, 255, 1), DiffuseBitmap=animmanager.image)
